# Grasshopper definition BirdFlocking_GH_Simon.gh (Grasshopper 1.0.7)

panel = Panel("C:\Users\simon\Dropbox\ITECH 2018-2019\ComputationalDesign\Assignments\FinalAssignment\CompDesing_Birdflocking\BirdFlocking\BirdFlocking.py")
pt = Point(Point(149.5442143, 19.01668086, 22.29682554))
file = ReadFile(File=panel, PerLineParse=False)
tag = TextTag(Location=pt, Text="Maultaschen")
python = GhPythonScript(iDistance=Slider(4.78, range=0..10))  # -> out, a, b, c
# ---------- python: Python ----------
import Rhino.Geometry as rg
import random as rnd

iPoints = []

for i in range(0,50):
    iPoints.append(rg.Point3d(rnd.uniform(0,10.0),rnd.uniform(0,10.0),rnd.uniform(0,10.0)))


closestPoints = list(rg.RTree.Point3dClosestPoints(iPoints,[iPoints[4]],iDistance))

print closestPoints[0]

a=iPoints
b=iPoints[4]
c= []
for point in closestPoints[0]:
    c.append(iPoints[point])
# ---------- end python ----------
timer = Timer(TimerInterval=20, Target=python_2)  # disabled
python_2 = GhPythonScript(
    Code=file,
    IReset=Button(),
    IEnabled=Toggle(False),
    IAgentCount=Slider(145, range=0..1100),
    ISpeed=Slider(0.79, range=0..1),
    IFoodStrength=Slider(7.22, range=0..50),
    IFoodSource=pt,
    ISeparationStrength=Slider(15.09, range=0..70),
    ISeparationDistance=Slider(10.98, range=0..50),
    IDetectonDistance=Slider(7.61, range=0..100),
    IWindSpeedX=Slider(52.7, range=0..100))  # -> Out, OHistory, OPositions, OPositions2
preview = CustomPreview(Geometry=python.b, Material=ColourSwatch(SwatchColor=RGB(255, 0, 64)))
preview_2 = CustomPreview(Geometry=python.c, Material=ColourSwatch(SwatchColor=RGB(210, 250, 64)))
crv = Curve(python_2.OHistory)
pt_2 = Point(python_2.OPositions)
preview_3 = CustomPreview(Geometry=python_2.OPositions2, Material=ColourSwatch(SwatchColor=RGB(210, 250, 64)))
