# Grasshopper definition BirdFlocking_GH_merged_00.gh (Grasshopper 1.0.7)

# ---- group: Init
path = FilePath("C:\Users\Tim Stark\Desktop\ITECH_CompDesign\FinalAssignment\BirdFlocking\BirdFlocking.py")
button = Button()
toggle = BooleanToggle(True)
file = ReadFile(File=path, PerLineParse=False)

# ---- group: Birds
number_slider = Slider(4, range=1..10)
number_slider_2 = Slider(10, range=0..1100)
panel = Panel(".03")
number_slider_3 = Slider(1.5, range=0..2)
number_slider_4 = Slider(35.99, range=0..70)
number_slider_5 = Slider(18.95, range=0..50)
number_slider_6 = Slider(23.66, range=0..100)
pt = Point([Point(105.6824141, 10.82329795, 49.90659043), Point(-129.2944747, -3.739051543, 170.607867), Point(564.5166908, -49.45837991, 92.50928147), Point(572.5956, 10.22349039, 111.9968146)])

# ---- group: Wind
number_slider_7 = Slider(2.3, range=0..10)
upliftcurve = Curve([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])
panel_2 = Panel("""40
20""")
panel_3 = Panel(""".9
.9""")

# ---- group: Food
foodlocation = Point([Point(19, -295, 0), Point(219, 506, 0), Point(336, -275, -8.923120136), Point(1158, 310, 0)])
panel_4 = Panel("""3
2""")
tag = TextTag(Location=foodlocation, Text="Maultaschen")

# ---- group: Environment
number_slider_8 = Slider(20, range=0..20)
brepobstacles = Brep([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])

# ---- group: Predator
number_slider_9 = Slider(1, range=0..10)
predatorspawn = Point([Point(-50, 366, 49.36581011), Point(578, -116, 119.3269014)])
number_slider_10 = Slider(200, range=0..200)
number_slider_11 = Slider(1, range=1..10)
panel_5 = Panel(".1")

# ----
brep = Brep(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)
timer = Timer(TimerInterval=20, Target=python)

opacity = WindowOpacity(A=Slider(1, range=0..1))

python = GhPythonScript(
    Code=file,
    IReset=button,
    IEnabled=toggle,
    IAgentSpawnLocations=pt,
    INestCount=number_slider,
    IAgentCount=number_slider_2,
    IAgentVelocity=panel,
    IAlignStrength=Slider(10, range=0..10),
    ICohesionStrength=Slider(15, range=0..100),
    ISpeed=number_slider_3,
    IFoodSpawnLocations=foodlocation,
    ISeparationStrength=number_slider_4,
    ISeparationDistance=number_slider_5,
    IDetectonDistance=number_slider_6,
    IWindSpeed=number_slider_7,
    ICollideStrength=number_slider_8,
    IBoundingBox=brep,
    IObstacleBreps=brepobstacles,
    IUpliftStrength=panel_4,
    IUpliftCrvs=upliftcurve,
    IUpliftRadius=panel_2,
    IUpliftRevolveStrength=panel_3,
    IPredatorSpawnLocations=predatorspawn,
    IPredatorCount=number_slider_9,
    IPredatorVelocity=panel_5,
    IPredatorRadius=number_slider_10,
    IPredatorSpeed=number_slider_11)  # -> Out, OWind, OFood, OFoodTag, OBirdHistory, OBirdPositions, OBirdTag, OPredatorHistory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
pt_2 = Point()

# ---- group: Opredator
sph = Sphere(Base=python.OPredatorPositions, Radius=2)
tag_2 = TextTag(Location=python.OPredatorPositions, Text=python.OPredatorTag, Colour="orange")
preview = CustomPreview(Geometry=sph, Material="255, 65, 77")
preview_2 = CustomPreview(Geometry=python.OPredatorHistory, Material="255, 65, 77")

# ---- group: oWind
pt_3 = ConstructPoint(XCoordinate=0, YCoordinate=0, ZCoordinate=0)
vdis = VectorDisplay(Anchor=pt_3, Vector=python.OWind)

# ---- group: Obird
preview_3 = CustomPreview(Geometry=python.OBirdHistory, Material="0, 111, 140")
preview_4 = CustomPreview(Geometry=python.OBirdPositions, Material="0, 111, 140")
tag_3 = TextTag(Location=python.OBirdPositions, Text=python.OBirdTag, Colour="255, 65, 77")

# ----
tag_4 = TextTag(Location=python.OFood, Text=python.OFoodTag)

# ==== cluster WindowOpacity
A = ClusterInput()
c_script = CSharpScript(A=A)  # -> out, e; inputs A: Double
# ---------- c_script: C# ----------
    System.Windows.Forms.Form form = Instances.DocumentEditor;


    A = Math.Min(A, 1.0);
    A = Math.Max(A, 0.1);

    form.Opacity = A;
# ---------- end c_script ----------
