# Grasshopper definition BirdFlocking_GH_v02_SL.gh (Grasshopper 1.0.7)

panel = Panel("C:\Users\simon\Dropbox\ITECH 2018-2019\ComputationalDesign\Assignments\FinalAssignment\CompDesing_Birdflocking\BirdFlocking\BirdFlocking.py")

opacity = WindowOpacity(A=Slider(1, range=0..1))

number_slider = Slider(17.07, range=0..70)
file = ReadFile(File=panel, PerLineParse=False)
panel_2 = Panel("""40
20""")
panel_3 = Panel(""".9
.9""")
panel_4 = Panel("""3
2""")
python = GhPythonScript()  # -> out, a
# ---------- python: Python ----------
__author__ = "Tim Stark"
__version__ = "2019.02.07"

import rhinoscriptsyntax as rs
import Rhino.Geometry as rg

rg.Vector3d.Rotate(
# ---------- end python ----------
# NEEDS TO BE RENAMED
# decide for test or not
brep = Brep([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])
pt = Point([Point(85, 328.4701688, 122.389809), Point(91.8967868, -206, 13.84393436), Point(366.3661915, -113.4244158, -6.504331314), Point(247.2849894, -287, 108.0239811)])
pt_2 = Point([Point(-50, 366, 49.36581011), Point(204.9479013, 67.45991967, 119.3269014)])
pt_3 = Point([Point(19, -295, 0), Point(219, 506, 0), Point(336, -275, -8.923120136), Point(1158, 310, 0)])
tag = TextTag(Location=pt_3, Text="Maultaschen")
crv = Curve([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])
timer = Timer(TimerInterval=20, Target=python_2)
python_2 = GhPythonScript(
    Code=file,
    IReset=Button(),
    IEnabled=Toggle(True),
    IAgentSpawnLocations=pt,
    IAgentCount=Slider(33, range=0..1100),
    IAgentVelocity=".03",
    ISpeed=Slider(1.18, range=0..2),
    IFoodSpawnLocations=pt_3,
    ICohesionStrength=Slider(17.7, range=0..100),
    IAlignStrength=Slider(11.5, range=0..100),
    ISeparationDistance=Slider(12.31, range=0..50),
    IDetectonDistance=Slider(17.07, range=0..100),
    IWindSpeed=Slider(2.1, range=0..500),
    ICollideStrength=Slider(20, range=0..20),
    IObstacleBreps=brep,
    IUpliftStrength=panel_4,
    IUpliftCrvs=crv,
    IUpliftRadius=panel_2,
    IUpliftRevolveStrength=panel_3,
    IPredatorSpawnLocations=pt_2,
    IPredatorCount=Slider(8, range=0..10),
    IPredatorVelocity=".1",
    IPredatorRadius=Slider(191, range=0..400),
    IPredatorSpeed=Slider(1.33, range=1..10))  # -> Out, OWind, OBirdHistory, OBirdPositions, ObirdVelocities, OBirdTag, OPredatorHistory, OPredatorPositions, OPredatorTag
panel_5 = Panel(python_2.Out)
pt_4 = ConstructPoint(XCoordinate=0, YCoordinate=0, ZCoordinate=0)
sph = Sphere(Base=python_2.OPredatorPositions, Radius=2)
tag_2 = TextTag(Location=python_2.OPredatorPositions, Text=python_2.OPredatorTag, Colour="orange")
vdis = VectorDisplay(Anchor=pt_4, Vector=python_2.OWind)
tag_3 = TextTag(Location=python_2.OBirdPositions, Text=python_2.OBirdTag, Colour="255, 65, 77")
vdis_2 = VectorDisplay(Anchor=python_2.OBirdPositions, Vector=python_2.ObirdVelocities)
preview = CustomPreview(Geometry=sph, Material="255, 65, 77")
preview_2 = CustomPreview(Geometry=python_2.OPredatorHistory, Material="255, 65, 77")
preview_3 = CustomPreview(Geometry=python_2.OBirdHistory, Material="0, 111, 140")
preview_4 = CustomPreview(Geometry=python_2.OBirdPositions, Material="0, 111, 140")

# ==== cluster WindowOpacity
A = ClusterInput()
c_script = CSharpScript(A=A)  # -> out, e; inputs A: Double
# ---------- c_script: C# ----------
    System.Windows.Forms.Form form = Instances.DocumentEditor;


    A = Math.Min(A, 1.0);
    A = Math.Max(A, 0.1);

    form.Opacity = A;
# ---------- end c_script ----------
