# Grasshopper definition BirdFlocking_GH_v02_ts.gh (Grasshopper 1.0.7)

# ---- group: Init
path = FilePath("C:\Users\guill\Documents\ITECH\Computational design\CD - Final Assignment\BirdFlocking\BirdFlocking.py")
button = Button()
toggle = BooleanToggle(True)
file = ReadFile(File=path, PerLineParse=False)

# ---- group: Birds
pt = Point([Point(-70.48275601, 474, 122.389809), Point(-101, -206, -43.6024821), Point(467, 359, -118.0563509), Point(414, -287, -33.87733065)])
number_slider = Slider(40, range=0..1100)
panel = Panel(".03")
number_slider_2 = Slider(1, range=0..2)
number_slider_3 = Slider(35.99, range=0..70)
number_slider_4 = Slider(18.95, range=0..50)
number_slider_5 = Slider(23.66, range=0..100)

# ---- group: Wind
number_slider_6 = Slider(8.2, range=0..10)
upliftcurve = Curve([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])
panel_2 = Panel("""40
20""")
panel_3 = Panel(""".9
.9""")

# ---- group: Food
foodlocation = Point([Point(19, -295, 0), Point(219, 506, 0), Point(336, -275, -8.923120136), Point(1158, 310, 0)])
panel_4 = Panel("""3
2""")
tag = TextTag(Location=foodlocation, Text="Maultaschen")

# ---- group: Environment
number_slider_7 = Slider(20, range=0..20)
brepobstacles = Brep([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])

# ---- group: Predator
number_slider_8 = Slider(4, range=0..10)
predatorspawn = Point([Point(-50, 366, 49.36581011), Point(578, -116, 119.3269014)])
number_slider_9 = Slider(200, range=0..200)
number_slider_10 = Slider(1, range=1..10)
panel_5 = Panel(".1")

# ----
# NEEDS TO BE RENAMED
# decide for test or not
timer = Timer(TimerInterval=20, Target=python)  # disabled

opacity = WindowOpacity(A=Slider(1, range=0..1))

python = GhPythonScript(
    Code=file,
    IReset=button,
    IEnabled=toggle,
    IAgentSpawnLocations=pt,
    IAgentCount=number_slider,
    IAgentVelocity=panel,
    ISpeed=number_slider_2,
    IFoodSpawnLocations=foodlocation,
    ISeparationStrength=number_slider_3,
    ISeparationDistance=number_slider_4,
    IDetectonDistance=number_slider_5,
    IWindSpeed=number_slider_6,
    ICollideStrength=number_slider_7,
    IObstacleBreps=brepobstacles,
    IUpliftStrength=panel_4,
    IUpliftCrvs=upliftcurve,
    IUpliftRadius=panel_2,
    IUpliftRevolveStrength=panel_3,
    IPredatorSpawnLocations=predatorspawn,
    IPredatorCount=number_slider_8,
    IPredatorVelocity=panel_5,
    IPredatorRadius=number_slider_9,
    IPredatorSpeed=number_slider_10)  # -> Out, OWind, OBirdHistory, OBirdPositions, OBirdTag, OPredatorHistory, OPredatorPositions, OPredatorTag
panel_6 = Panel(python.Out)

# ---- group: Opredator
sph = Sphere(Base=python.OPredatorPositions, Radius=2)
tag_2 = TextTag(Location=python.OPredatorPositions, Text=python.OPredatorTag, Colour="orange")
preview = CustomPreview(Geometry=sph, Material="255, 65, 77")
preview_2 = CustomPreview(Geometry=python.OPredatorHistory, Material="255, 65, 77")

# ---- group: oWind
pt_2 = ConstructPoint(XCoordinate=0, YCoordinate=0, ZCoordinate=0)
vdis = VectorDisplay(Anchor=pt_2, Vector=python.OWind)

# ---- group: Obird
preview_3 = CustomPreview(Geometry=python.OBirdHistory, Material="0, 111, 140")
preview_4 = CustomPreview(Geometry=python.OBirdPositions, Material="0, 111, 140")
tag_3 = TextTag(Location=python.OBirdPositions, Text=python.OBirdTag, Colour="255, 65, 77")

# ==== cluster WindowOpacity
A = ClusterInput()
c_script = CSharpScript(A=A)  # -> out, e; inputs A: Double
# ---------- c_script: C# ----------
    System.Windows.Forms.Form form = Instances.DocumentEditor;


    A = Math.Min(A, 1.0);
    A = Math.Max(A, 0.1);

    form.Opacity = A;
# ---------- end c_script ----------
