# Grasshopper definition BirdFlocking_GH_v03_ts.gh (Grasshopper 1.0.7)

path = FilePath("C:\Users\Tim Stark\Desktop\ITECH_CompDesign\FinalAssignment\BirdFlocking\BirdFlocking.py")

opacity = WindowOpacity(A=Slider(1, range=0..1))

file = ReadFile(File=path, PerLineParse=False)
panel = Panel("""40
20""")
panel_2 = Panel("""3
2""")
panel_3 = Panel(""".9
.9""")
python = GhPythonScript()  # -> out, a
# ---------- python: Python ----------
__author__ = "Tim Stark"
__version__ = "2019.02.07"

import rhinoscriptsyntax as rs
import Rhino.Geometry as rg

rg.Vector3d.Rotate(
# ---------- end python ----------
# NEEDS TO BE RENAMED
# decide for test or not
brep = Brep([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])
pt = Point([Point(-216, -85, 0), Point(1048, -56, 0), Point(580, 631, 0), Point(-606, 1046, 0)])
pt_2 = Point([Point(-623, 1160, 0), Point(-265, -96, 0), Point(1049, -29, 0), Point(567, 717, 0)])
pt_3 = Point([Point(714, 340, 0), Point(-10, 928, 0), Point(-452, 470, 0), Point(69, -764, 0), Point(935, -945, 0), Point(747, -292, 0), Point(944, 652, 0), Point(1503, 474, 0), Point(877, 735, 0), Point(807, 987, 0)])
crv = Curve([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])
timer = Timer(TimerInterval=20, Target=python_2)
python_2 = GhPythonScript(
    Code=file,
    IReset=Button(),
    IEnabled=Toggle(True),
    IAgentSpawnLocations=pt_2,
    IAgentCount=Slider(40, range=0..1100),
    IAgentVelocity=".03",
    ISpeed=Slider(1, range=0..2),
    IFoodSpawnLocations=pt_3,
    ISeparationStrength=Slider(35.99, range=0..70),
    ISeparationDistance=Slider(18.95, range=0..50),
    IDetectonDistance=Slider(23.66, range=0..100),
    IWindSpeed=Slider(8.2, range=0..10),
    ICollideStrength=Slider(20, range=0..20),
    IObstacleBreps=brep,
    IUpliftStrength=panel_2,
    IUpliftCrvs=crv,
    IUpliftRadius=panel,
    IUpliftRevolveStrength=panel_3,
    IPredatorSpawnLocations=pt,
    IPredatorCount=Slider(4, range=0..10),
    IPredatorVelocity=".1",
    IPredatorRadius=Slider(200, range=0..200),
    IPredatorSpeed=Slider(1.2, range=1..10))  # -> Out, OWind, OFood, OAmountFood, OBirdHistory, OBirdPositions, OBirdTag, OPredatorHistory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
panel_4 = Panel(python_2.Out)
python_3 = GhPythonScript()  # -> out, a
# ---------- python_3: Python ----------
__author__ = "Tim Stark"
__version__ = "2019.02.09"

import rhinoscriptsyntax as rs
c = []
for i in range(5):
    c.append(i)
    
a = c
# ---------- end python_3 ----------
sph = Sphere(Base=python_2.OPredatorTarget, Radius=2)
pt_4 = ConstructPoint(XCoordinate=0, YCoordinate=0, ZCoordinate=0)
sph_2 = Sphere(Base=python_2.OPredatorPositions, Radius=2)
tag = TextTag(Location=python_2.OFood, Text=python_2.OAmountFood, Colour=RGB(0, 255, 91))
tag_2 = TextTag(Location=python_2.OPredatorPositions, Text=python_2.OPredatorTag, Colour="orange")
vdis = VectorDisplay(Anchor=pt_4, Vector=python_2.OWind)
tag_3 = TextTag(Location=python_2.OBirdPositions, Text=python_2.OBirdTag, Colour="255, 65, 77")
preview = CustomPreview(Geometry=sph, Material="orange")
preview_2 = CustomPreview(Geometry=sph_2, Material="255, 65, 77")
preview_3 = CustomPreview(Geometry=python_2.OPredatorHistory, Material="255, 65, 77")
preview_4 = CustomPreview(Geometry=python_2.OBirdHistory, Material="0, 111, 140")
preview_5 = CustomPreview(Geometry=python_2.OBirdPositions, Material="0, 111, 140")

# ==== cluster WindowOpacity
A = ClusterInput()
c_script = CSharpScript(A=A)  # -> out, e; inputs A: Double
# ---------- c_script: C# ----------
    System.Windows.Forms.Form form = Instances.DocumentEditor;


    A = Math.Min(A, 1.0);
    A = Math.Max(A, 0.1);

    form.Opacity = A;
# ---------- end c_script ----------
